vi "NI-DMM Continuously Acquire And Chart Multiple Samples.gvi"   [LabVIEW NXG 4.0.0]
# This example demonstrates how to continuously acquire measurements and display them in a waveform graph. Select the measurement function, range, and absolute resolution. The Initiate function starts the acquisition. The requested samples are returned using the Fetch function within the loop. The data is displayed in a waveform chart. The acquisition is aborted when the Stop button is pressed.
panel controls:
  "Range": i32 = -1  # Specify the range for the measurement. Sets the range for the function specified in the Measurement Type control. Range values are coerced up to the closest input range.
  "Resource Name": "DMM niDMM" = "Dev1"  # Specify the resource name of the NI DMM device to initialize.
  "Measurement Type": "Function.gtype" = "4-wire Resistance"  # Specify the measurement function used to acquire the measurement. The driver sets the NIDMM_ATTR_FUNCTION attribute to this value.
  "Resolution (Digits)": "Resolution in Digits.gtype" = "6 1/2"(6.5)  # Specify the resolution of the measurement in digits. The NI 4080/4081/4082 uses the resolution you specify. The NI 4065 and NI 4070/4071/4072 ignores this parameter when Range is set to AUTO RANGE ON (-1.0) or AUTO RANGE ONCE (-3.0). The default is 5.5 Digits.
  "Stop": bool  # Stop the VI.
  "Samples / Sec": f64 = 2
  "Run Number": string = "35"
panel indicators:
  "Measurements": f64[]  # This chart shows the measurement values. The Y axis is the amplitude of the measurements in the unit of the measurement type selected.
types:
  "Function.gtype" = enum{"DC Volts", "AC Volts", "DC Current", "AC Current", "2-wire Resistance", "4-wire Resistance", "Diode", "Frequency", "Period", "AC Volts DC Coupled", "Capacitance", "Inductance", "Temperature"}
  "Resolution in Digits.gtype" = f64
uses:
  NI::DMM::Initialize With Options.gvi
  NI::DMM::Configure Measurement Digits.gvi
  NI::DMM::Configure Multi Point.gvi
  NI::DMM::Initiate.gvi
  NI::DMM::Read Status.gvi
  NI::DMM::Fetch Multi Point.gvi
  NI::DMM::Abort.gvi
  NI::DMM::Close.gvi
  NI::G Core::Error::Display Error.gvi
  NI::G Core::Error::Clear Error Cluster.gvi
diagram:
  w1 = path "C:\\Users\\jobsw\\OneDrive\\Desktop\\Mike\\Distillation_Code\\DataProcessing\\data"
  Concatenate Strings("DistillationRun", $"Run Number") -> w2
  Concatenate Strings(w2, "_DMM.txt") -> w3
  String To Path(string=w3) -> (path=w4)
  Build Path(base path=w1, name or relative path=w4) -> (appended path=w5)
  Delete File Or Folder(path (use dialog)=w5) -> (deleted path=w6, error out=w7)
  Open Or Create Or Replace File(access (0:read/write)="write-only", file path (use dialog)=w6, operation (0:open)="create") -> (error out=w8, refnum out=w9)
  w10 = 0  # Sample Count
  # Demonstrates how to continuously acquire measurements and display them in a waveform graph. Refer to the panel to see the results.
  # 1
  call "Initialize With Options.gvi"(resource name=$"Resource Name") -> (error out=w11, session out=w12)
  # 2
  call "Configure Measurement Digits.gvi"(range=$Range, resolution in digits=$"Resolution (Digits)", error in=w11, function=$"Measurement Type", session in=w12) -> (error out=w13, session out=w14)
  # 3
  call "Configure Multi Point.gvi"(error in=w13, sample count=w10, session in=w14) -> (error out=w15, session out=w16)
  # 4
  call "Initiate.gvi"(error in=w15, session in=w16) -> (error out=w17, session out=w18)
  Divide(x=1, y=$"Samples / Sec") -> w19
  # File read/write performance is dependent upon the size of the data written to disk.  This optimum "chunk" size will depend upon your operating system and disk block size.  For example, in Windows, reading or writing in 65,000 byte chunks will often optimize performance.
  Multiply(w19, 1000) -> w20
  while {
    # 5
    call "Read Status.gvi"(error in=w17, session in=w18) -> (error out=w21, session out=w22)
    # 6
    call "Fetch Multi Point.gvi"(number to fetch=1, error in=w21, session in=w22) -> (error out=w23, measurements=w24, session out=w25)
    $Measurements <- w24
    Property Node(instance in=w23) -> ("status"=w26)
    # 7
    Logical Or(w26, $Stop) -> w27
    Get Date And Time String(want seconds? (F)=TRUE) -> (time string=w28)
    Array To Spreadsheet String(array=w24, format string="%.3f") -> (spreadsheet string=w29)
    Concatenate Strings(w28, "\t", w29) -> w30
    Write To Text File(error in=w8, file (use dialog)=w9, text=w30) -> (error out=w31, refnum out=w32)
    Wait(time to wait=w20)
    stop if w27
  }
  # 8
  call "Abort.gvi"(error in=w23, session in=w25) -> (error out=w33, session out=w34)
  # 9
  call "Close.gvi"(error in=w33, session in=w34) -> (error out=w35)
  # 10
  call "Display Error.gvi"(error in=w35)
  Close File(error in=w31, refnum=w32) -> (error out=w36)
  call "Display Error.gvi"(error in=w36)
  call "Clear Error Cluster.gvi"(error in=w7)
